# Dynamo graph GetLispFileOfCS_RUS.dyn (Dynamo 2.5.2.7915)
# packages: MapConnection 1.0.6

# group: Input data
pathToLocationFile = StringInput("C:\")
CS_Language_RUS = MapConnection.MapCSLibrary.CS_Language_RUS()
boolean = BoolSelector(false)

getPartOfMAPCSLIBRARY = MapConnection.MapCSLibrary.GetPartOfMAPCSLIBRARY(Folder_Path=pathToLocationFile, CS_value=CS_Language_RUS.CS_value, CS_Agree=CS_Language_RUS.CS_Agree, selection=boolean)
CS_Language_ENG = MapConnection.MapCSLibrary.CS_Language_ENG()
