# Dynamo graph ConvertTMtoGeodeticAndTM.dyn (Dynamo 2.5.2.7915)
# packages: MapConnection 1.0.6

# group: Руководство к использованию
# note: Указания к использованию:
# Данный скрипт позволяет пересчитать прямоугольные координаты чертежа из одной МСК в другую МСК на эллипсоиде Красовского (фактически, это все СК кроме МГГТ, для которой будет отдельный скрипт, дополненный датумом)
# В качестве исходных данных он принимает либо преднастроенные параметры систем координат/эллипсоидов/датумов либо пользовательские параметры (розовая группа)

# group: Ellipsoid's selection/Выбор эллипсоидов
esisting_ellipsoids_доступные = CodeBlock()  # "Esisting ellipsoids/Доступные эллипсоиды"
# ---------- esisting_ellipsoids_доступные.designscript (6 lines) ----------
"Krassowsky 1940, EPSG:7024";
"WGS-84, EPSG:7030";
"GSK-2011, EPSG:1025";
"PZ 90.11";
"PZ 90/PZ 90.02, EPSG:7054";
"Bessel 1841, EPSG:7004";
# ----------------------------------------
source_ellipsoid = MapConnection.GeneralTerms.EllipsoidParameters(EllipsoidName=esisting_ellipsoids_доступные.out0)

# group: Системы координат (CS)
CS_Russia_MSK47_Zona2 = MapConnection.ResourceLibrary.CS_Russia_MSK47_Zona2()
getCSParameters = MapConnection.GeneralTerms.GetCSParameters(CS_Name=CS_Russia_MSK47_Zona2)
CS_Russia_MSK1964 = MapConnection.ResourceLibrary.CS_Russia_MSK1964()
getCSParameters_2 = MapConnection.GeneralTerms.GetCSParameters(CS_Name=CS_Russia_MSK1964)

координаты_точек_double = CodeBlock { 116479.50982048; 99975.21929290; }

# group: TransverseMercator projection (rectangle coordinates) to geodetic coordinates/Проекция Поперечная Меркатора (прямоугольные координаты) в геодезические координаты
TM_FromRectangleToGeodetic = MapConnection.CoordTransform.TM_FromRectangleToGeodetic(Ellipsoid=source_ellipsoid, CS_Params=getCSParameters_2, CoordX=координаты_точек_double.out0, CoordY=координаты_точек_double.out1)

# group: TransverseMercator projection (geodetic coordinates) to rectangle coordinates/Проекция Поперечная Меркатора (геодезические координаты) в прямоугольные координаты
TM_FromGeodeticToRectangle = MapConnection.CoordTransform.TM_FromGeodeticToRectangle(Ellipsoid=source_ellipsoid, CS_Params=getCSParameters, Latitude=TM_FromRectangleToGeodetic.Latitude_radians, Longitude=TM_FromRectangleToGeodetic.Longitude_radians)

# group: Output parameters (may be deleted)/Выходные параметры (могут быть удалены)
watch = Watch(TM_FromGeodeticToRectangle.Coord_X_meters)
watch_2 = Watch(TM_FromGeodeticToRectangle.Coord_Y_meters)

# group: For debugging and checking
source_cs_s_definition = Watch(getCSParameters_2)
source_ellipsoid_2 = Watch(source_ellipsoid)
finish_cs_s_definition = Watch(getCSParameters)

# group: Example of custom Ellipsoid (Airy 1830)
ellipsoid_airy_1830 = CodeBlock { "6377563.396"; "299.32496"; }
custom_EllipsoidParameters = MapConnection.GeneralTerms.Custom_EllipsoidParameters(Axis_a_meters=ellipsoid_airy_1830.out0, Flattening=ellipsoid_airy_1830.out1)

# group: Example of User CS's definition
russia_moscow_cs_msk_50_zona2 = CodeBlock { "Russia-MSK50-Zona2,0,38.48333333333,1,2250000,-5712900.566"; }

# group: Example of User CS's definition
пользовательская_ск = CodeBlock { "Имя,Широта начала,Долгота осевого меридиана,Масштаб,Неверный запад,Неверный север"; }
user_cs = CodeBlock { "Name of CS,Latitude of natural origin,Longitude,Scale factor,False Easting,False Northing"; }
