# Dynamo graph GetLispFileOfCS_ENG.dyn (Dynamo 2.5.2.7915)
# packages: MapConnection 1.0.6

# group: Input data
CS_Language_RUS = MapConnection.MapCSLibrary.CS_Language_RUS()
pathToLocationFile = StringInput("C:\")
boolean = BoolSelector(false)

CS_Language_ENG = MapConnection.MapCSLibrary.CS_Language_ENG()
getPartOfMAPCSLIBRARY = MapConnection.MapCSLibrary.GetPartOfMAPCSLIBRARY(Folder_Path=pathToLocationFile, CS_value=CS_Language_ENG.CS_value, CS_Agree=CS_Language_ENG.CS_Agree, selection=boolean)
