# Dynamo graph GetWKT2CodesOfCSList.dyn (Dynamo 2.5.2.7915)
# packages: MapConnection 1.0.6

pathtoxml_library = Filename("..\..\..\..\..\Users\GeorgKeneberg\Documents\CSLibrary.xml")
savePathFolder = StringInput("C:\Users\GeorgKeneberg\Documents\Temp")

# group: Input data
string = StringInput("C:\Users\GeorgKeneberg\Documents\Temp")
boolean = BoolSelector(false)

getCSList = MapConnection.MapCSLibrary.GetCSList(Folder_Path=string, selection=boolean)
boolean_2 = BoolSelector(true)
getWKT2Code_ofCSList = MapConnection.CoordinateSystems.GetWKT2Code_ofCSList(XML_MapCSLibrary_path=pathtoxml_library, Folder_Path=savePathFolder, TXT_CS_List_path=getCSList, str_format=boolean_2)
