# Dynamo graph Recalc MSK-66-2 to EKB-town.dyn (Dynamo 2.8.0.2015)

code_block = CodeBlock { "Russia-MSK66-Zona2"; "Russia-Town-Ekarinburg"; }
code_block_2 = CodeBlock { "2349579.43"; "394147.37"; }
calc_ProjTM = MapConnection.CoordTransform.Calc_ProjTM(Source_CS_Name=code_block.out0, Finish_CS_Name=code_block.out1, X=code_block_2.out0, Y=code_block_2.out1)
watch = Watch(calc_ProjTM.Coord_X)
watch_2 = Watch(calc_ProjTM.Coord_Y)
code_block_3 = CodeBlock { 57.29577958; }
mul = calc_ProjTM.Latitude_grades * code_block_3
watch_3 = Watch(mul)
mul_2 = calc_ProjTM.Longitude_grades * code_block_3
watch_4 = Watch(mul_2)
