# Dynamo graph WKT Одиночный.dyn (Dynamo 2.5.2.7915)

string = StringInput("C:\Users\GeorgKeneberg\Documents\Temp\LOG\1.csv")
getCurrentCoordinateSystem = MapConnection.CoordinateSystems.GetCurrentCoordinateSystem()
file_path = Filename("C:\Users\GeorgKeneberg\Documents\Temp\CSLibrary.xml")
getFullWKTCodeOfCS = MapConnection.CoordinateSystems.GetFullWKTCodeOfCS(Current_CS=getCurrentCoordinateSystem, XML_MapCSLibrary_path=file_path)
exportCSV = Data.ExportCSV(filePath=string, data=getFullWKTCodeOfCS.Full_WKT)
