# Dynamo graph WKT полные.dyn (Dynamo 2.5.2.7915)

file_path = Filename("C:\Users\GeorgKeneberg\Documents\Temp\CSLibrary.xml")
boolean = BoolSelector(false)
boolean_2 = BoolSelector(false)
getFullWKTCodeOfAllCS = MapConnection.MapCSLibrary.GetFullWKTCodeOfAllCS(XML_MapCSLibrary_path_Full=file_path, selection=boolean, all_data=boolean_2)
