# Dynamo graph WKT_1.dyn (Dynamo 2.5.2.7915)

getCurrentCoordinateSystem = MapConnection.CoordinateSystems.GetCurrentCoordinateSystem()
file_path = Filename("E:\Work\Temp\Temp\CSLibrary.xml")
getFullWKTCodeOfCS = MapConnection.CoordinateSystems.GetFullWKTCodeOfCS(Current_CS=getCurrentCoordinateSystem, XML_MapCSLibrary_path=file_path)
getGeodedictDescrOfCS_TM = MapConnection.CoordinateSystems.GetGeodedictDescrOfCS_TM(Full_WKT_string=getFullWKTCodeOfCS.Full_WKT)
