# Dynamo graph Перевод координат из МСК в МСК на элл. Красовского.dyn (Dynamo 2.11.0.4172)
# packages: MapConnection 1.0.6

# group: Руководство к использованию
# note: Указания к использованию:
# Данный скрипт позволяет пересчитать прямоугольные координаты чертежа из одной МСК в другую МСК на эллипсоиде Красовского (фактически, это все СК кроме МГГТ, для которой будет отдельный скрипт, дополненный датумом)
# В качестве исходных данных он принимает либо преднастроенные параметры систем координат/эллипсоидов/датумов либо пользовательские параметры (розовая группа)

# group: Ellipsoid's selection/Выбор эллипсоидов
esisting_ellipsoids_доступные = CodeBlock()  # "Esisting ellipsoids/Доступные эллипсоиды"
# ---------- esisting_ellipsoids_доступные.designscript (6 lines) ----------
"Krassowsky 1940, EPSG:7024";
"WGS-84, EPSG:7030";
"GSK-2011, EPSG:1025";
"PZ 90.11";
"PZ 90/PZ 90.02, EPSG:7054";
"Bessel 1841, EPSG:7004";
# ----------------------------------------
source_ellipsoid = MapConnection.GeneralTerms.EllipsoidParameters(EllipsoidName=esisting_ellipsoids_доступные.out0)

первая_ск_откуда_переводим = MapConnection.ResourceLibrary.CS_Russia_MSK66_Zona2()

# group: CS's definition/Описание проекции СК
вторая_ск_куда_переводим = MapConnection.ResourceLibrary.CS_Russia_Town_EKB_1()
getCSParameters = MapConnection.GeneralTerms.GetCSParameters(CS_Name=вторая_ск_куда_переводим)
getCSParameters_2 = MapConnection.GeneralTerms.GetCSParameters(CS_Name=первая_ск_откуда_переводим)

координаты_точек_double = CodeBlock { 2349683.45372327; 394436.93516466; }

# group: TransverseMercator projection (rectangle coordinates) to geodetic coordinates/Проекция Поперечная Меркатора (прямоугольные координаты) в геодезические координаты
TM_FromRectangleToGeodetic = MapConnection.CoordTransform.TM_FromRectangleToGeodetic(Ellipsoid=source_ellipsoid, CS_Params=getCSParameters_2, CoordX=координаты_точек_double.out0, CoordY=координаты_точек_double.out1)

# group: TransverseMercator projection (geodetic coordinates) to rectangle coordinates/Проекция Поперечная Меркатора (геодезические координаты) в прямоугольные координаты
TM_FromGeodeticToRectangle = MapConnection.CoordTransform.TM_FromGeodeticToRectangle(Ellipsoid=source_ellipsoid, CS_Params=getCSParameters, Latitude=TM_FromRectangleToGeodetic.Latitude_radians, Longitude=TM_FromRectangleToGeodetic.Longitude_radians)

# group: Output parameters (may be deleted)/Выходные параметры (могут быть удалены)
watch = Watch(TM_FromGeodeticToRectangle.Coord_X_meters)
watch_2 = Watch(TM_FromGeodeticToRectangle.Coord_Y_meters)

# group: Datum parameters/Параметры датума
datums_to_wgs_84 = CodeBlock()
# ---------- datums_to_wgs_84.designscript (6 lines) ----------
"23.57,-140.95,-79.8,0,-0.35,-0.79,-0.22";
"23.92,-141.27,-80.9,0.0,-0.35,-0.82,-0.12";
"28.0,-130.0,-95.0,0.0,0.0,0.0,0.0";
"24.47,-130.89,-81.56,0.0,0.0,-0.13,-0.22";
"24.82,-131.21,-82.66,0.0,0.0,-0.16,-0.12";
"316.151,78.924,589.65,1.57273,-2.69209,-2.34693,8.4507";
# ----------------------------------------
datums_to_wgs_84_names = CodeBlock()
# ---------- datums_to_wgs_84_names.designscript (6 lines) ----------
"For SK-42 to WGS-84 EPSG:5044";
"For SK-42 to WGS-84 and SK-63 EPSG:1267";
"For SK-42 to WGS-84 EPSG:1254";
"For SK-95 to WGS-84 EPSG:5043";
"For SK-95 to WGS-84 EPSG:1281";
"For MGGT to WGS-84";
# ----------------------------------------

# group: Инициализация датума
getDatumInfo = MapConnection.GeneralTerms.GetDatumInfo(InfoAboutDatum=datums_to_wgs_84.out3)

# group: For debugging and checking
datum_s_definition = Watch(getDatumInfo)
source_cs_s_definition = Watch(getCSParameters_2)
source_ellipsoid_2 = Watch(source_ellipsoid)
finish_cs_s_definition = Watch(getCSParameters)

# group: Example of custom Ellipsoid (Airy 1830)
ellipsoid_airy_1830 = CodeBlock { "6377563.396"; "299.32496"; }
custom_EllipsoidParameters = MapConnection.GeneralTerms.Custom_EllipsoidParameters(Axis_a_meters=ellipsoid_airy_1830.out0, Flattening=ellipsoid_airy_1830.out1)

# group: Example of User CS's definition
russia_moscow_cs_msk_50_zona2 = CodeBlock { "Russia-MSK50-Zona2,0,38.48333333333,1,2250000,-5712900.566"; }

# group: Example of User CS's definition
пользовательская_ск = CodeBlock { "Имя,Широта начала,Долгота осевого меридиана,Масштаб,Неверный запад,Неверный север"; }
user_cs = CodeBlock { "Name of CS,Latitude of natural origin,Longitude,Scale factor,False Easting,False Northing"; }

# group: Custom datum's definition
custom_datum_parameters = CodeBlock { "ΔX,ΔY,ΔZ,ω_x_rad,ω_y_rad,ω_z_rad,mE-6"; }
