# Dynamo graph Применение датума.dyn (Dynamo 2.5.1.7586)

epsg_5044 = CodeBlock { "23.57,-140.95,-79.8,0.00,-0.35,-0.79,-0.22"; }
getDatumInfo = MapConnection.CoordTransform_GeneralTerms.GetDatumInfo(InfoAboutDatum=epsg_5044)
ellipsoids_list = CodeBlock { "Krassowsky 1940, EPSG:7024"; "WGS-84, EPSG:7030"; }
ellipsoidParameters = MapConnection.CoordTransform_GeneralTerms.EllipsoidParameters(EllipsoidName=ellipsoids_list.out0)
ellipsoidParameters_2 = MapConnection.CoordTransform_GeneralTerms.EllipsoidParameters(EllipsoidName=ellipsoids_list.out1)
datum_Recalc = MapConnection.CoordTransform_GeneralTerms.Datum_Recalc(DatumInfo=getDatumInfo, SourceEllipsoid=ellipsoidParameters, FinishEllipsoid=ellipsoidParameters_2)  # unwired: Latitude1, Longitude1, Height1
