# Dynamo graph Создание LSP-файла всей библиотеки_ENG.dyn (Dynamo 2.4.1.6394)

directory_path = Directory("C:\Users\GeorgKeneberg\Documents\Temp")
CS_Language_ENG = MapConnection.MapCSLibrary.CS_Language_ENG()
boolean = BoolSelector(true)
getPartOfMAPCSLIBRARY = MapConnection.MapCSLibrary.GetPartOfMAPCSLIBRARY(Folder_Path=directory_path, CS_value=CS_Language_ENG.CS_value, CS_Agree=CS_Language_ENG.CS_Agree, selection=boolean)
