# Dynamo graph СохранениеWKTотСКвФайл.dyn (Dynamo 2.5.2.7915)
# packages: MapConnection 1.0.4

string = StringInput("C:\Users\GeorgKeneberg\Documents\Temp\CS.csv")
getWKTFromUnknownCS = MapConnection.CoordinateSystems.GetWKTFromUnknownCS()
exportCSV = Data.ExportCSV(filePath=string, data=getWKTFromUnknownCS)
