# Dynamo graph Формирование списка параметров СК.dyn (Dynamo 2.5.1.7586)

file_path = Filename("..\..\..\..\Temp\CSLibrary_12-03-2021.xml")
string = StringInput("E:\Work\Temp\Temp")
file_path_2 = Filename("C:\Users\Georg\Documents\14c2c9cd-6f23-44ec-b2ea-f0363d995d32CS_List.txt")
createCSList = MapConnection.CoordinateSystems.CreateCSList(XML_MapCSLibrary_path=file_path, Folder_Path=string, TXT_CS_List_path=file_path_2)
